# Requirement set FlightManagementSystem (R2021b)

## 1 [FUNC_FMS]

### 1.1 [NAV-FUNC] The system compute a trajectory following the flight plan
module NAV:
manage the flight plan,
compute legs and transitions

### 1.2 [GUID-FUNC] The system determine the desired route from flight plan
Module Guidage
compute the active leg
compute the track errors (cross track, angle error)

### 1.3 [CONTROL-FUNC] The system shall determine the attitude from desired route
Module Control:
compute the desired attitude from the route computed by guidance