# Requirement set guidance (R2021b)

## 1 [GUID-FUNC]

### 1.1 [GUID-FUNC-1] The system shall know the active leg at all times

### 1.2 [GUID-FUNC-3] The system shall compiute the distance between the aircraft's current position and the active waypoint.

### 1.3 [GUID-FUNC-2] The system shall compute transitions and follow the progress of the active leg

### 1.4 [GUID-FUNC-4] The system shall manage complex transitions and discontinuity cases
Assumption:
The function is not provided at the moment, TODO in further versions
Rationale: The system has to provide a flyable reference path, even if a leg is too short to connect the fly-by transition.

### 1.5 [GUID-FUNC-5] The system shall determine the fly-by transitions
The fly-by transitions are used to turn in nominal cases

### 1.6 [GUID-FUNC-6] The system shall determine the fly-over transitions
Rationale: The fly-over transitions are used when asked

### 1.7 [GUID-FUNC-7] Compute the different data from all the transitions, and create a list of paths (including fly-by or fly-over transitions).
Transitions are calculated with the different parameters (the active leg, the track change alpha, the lead distance, bank angle and turn radius of the next two transitions. Be careful to recalculate the track change, the lead distance, the bank angle and the turn radius for each transition).
Assumption :
The entire list of legs is given at preflight.
Rationale: The reference lateral path is an information sent to the autopilot, and sent to be displayed by the EFIS

### 1.8 [GUID-FUNC-8] The system shall, every 5 seconds, when the aircraft exits a transition or when the flight plan is modified, get the next transition and the next second transition.
Rationale: To be able to compute the next two transitions.

### 1.9 [GUID-FUNC-9] The system shall, every 5 seconds, when the aircraft exits a transition or when the flight plan is modified, get the speed prediction information.} {To use this speed in the computation of the next two transitions.
Assumption :
The assumed true air speed is constant during a transition.
Rationale: To use this speed in the computation of the next two transitions.

### 1.10 [GUID-FUNC-10] The system shall be able to compute the different data from the 2 next transitions, and create a list of paths (including fly-by or fly-over transitions).
Transitions are calculated with the different parameters (the active leg, the track change alpha, the lead distance, bank angle and turn radius of the next two transitions. Be careful to recalculate the track change, the lead distance, the bank angle and the turn radius for each transition).
Assumption :
The list of next paths (great circle distance + transition) is given every 5 seconds to update the trajectory.
It only corresponds to the trajectory to go through the next two transitions. The rest of the lateral path is the track to fix legs of the list of legs.
Rationale: This temporary reference lateral path is an information sent to the autopilot, and send to be displayed by the EFIS.
This function shall be computed every 5 second for the SEQ group.

### 1.11 [GUID-FUNC-11] The system shall, once a new transition has been computed, update the reference lateral path.
Rationale: To display the reference lateral path on the Navigation Display.

### 1.12 [GUID-FUNC-12] The system shall, every 5 seconds of when the aircraft exists a transition or when the flight plan is modified, send to HMI the reference lateral path.
Assumption :
The reference lateral path is displayed once it has been updated.
Rationale: To show to the pilot the exact trajectory he has to follow.

### 1.13 [GUID-FUNC-13] The prediction submodule shall compute the set of speed predictions. This system requests the list of legs sent by LEGS module and the maximum speed allowed given for each leg.
The speed predictions should be available to the other functions in a dictionary where each speed prediction is linked with a leg ID. The predictions refer to the predicted ground speeds at the leg termination.
Assumption :
It doesn't take into account weather conditions or parameters which are hard to calculate without a particular database. It only takes into account the cost index, the wind and CRZ_ALT given by the pilot.
Rationale: The speed predictions are to be used to compute the transition parameters and to give the altitude which have to be followed by the aircraft.

### 1.14 [GUID-FUNC-14] The prediction submodule shall compute the set of altitude predictions. This system requests the list of legs and the maximum and minimum altitudes (FL) allowed given for each leg.
The altitude predictions should be available to the other functions in a dictionary where each altitude prediction is linked with a leg ID. The predictions refer to the predicted altitude at the leg termination.
Assumption :
The prediction submodule doesn't take into weather conditions or parameters difficult to calculate without a particular Database. It only takes into account cost index, wind and CRZ_ALT given by the pilot.
Rationale: The altitude predictions are to be used to compute the transition parameters and to give the speed which have to be followed by the aircraft.

### 1.15 [GUID-FUNC-15] The prediction submodule shall send the predictions to transition.
Assumption :
Information could also be sent to HMI using QtSignals.
Rationale: The predictions are to be used to compute the transition parameters and to give the speed and altitude which have to be followed by the A/C.