# Requirement set navigation (R2021b)

## 1 [NAV-FUNC] The system provides functions to edit the flight plan
module NAV:
manage the flight plan,
link waypoints to create legs

### 1.1 [NAV-X] The system shall compute a flight plan from pilot input
-decode pilot input
-select a flight plan
-edit a flight plan
-perform copies

### 1.2 [NAV-FP] The system shall describea flight plan
-list of ordered waypoints
-contains departure, arrival and possibly alternate APT
-contains wind information
-indications : Flight Number, CI, Masses, etc.. as described in documentation
-compute predictions

### 1.3 [NAV-FP-TEMP] The temporary FP shall help pilot to visualize modifications to selected FP
-get prim (=active) FP
-modify it
-return a temporary FP
computes time and fuel predictions

### 1.4 [NAV-FP-PRIM] The system shall modify and follow the primary flight plan
input : init data or full flight plan
output : flight plan and predictions
contains flight plan data
computes time and fuel predictions

### 1.5 [NAV-FP-SEC] The system shall contain a secondary flight plan
input: init data or flight plan
output: flight plan
computes time and fuel predictions